# Grasshopper definition TestingSheetGeometryFromPoints.gh (Grasshopper 1.0.7)

rectangle = Rectangle(Plane=PlaneXY(0, 0, 0), XSize=Slider(30, range=0..100), YSize=Slider(30, range=0..100), Radius=0)  # -> Rectangle, Length
populate_2d = Populate2D(Region=rectangle.Rectangle, Count=Slider(1000, range=0..1000), Seed=1)
surface_from_points = SurfaceFromPoints(Points=populate_2d, UCount=Slider(10, range=0..10000), Interpolate=Toggle(True))
surface = Surface(surface_from_points)
